# Grasshopper definition RandomContextGenerator.gh (Grasshopper 1.0.7)
# plug-ins: Kangaroo2 Components, Pufferfish

geometry = Geometry([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])
mesh = Mesh(geometry)
mesh_join = MeshJoin(Meshes=mesh)
geometry_2 = GetGeometry(mesh_join, AtLeast=1, AtMost=2147483647, Filter=1074004029)
bounding_box = BoundingBox(Content=mesh_join, Plane=PlaneXY(0, 0, 0))  # -> Box, Box_2
area = Area(Geometry=bounding_box.Box)  # -> Area, Centroid
project = Project(Geometry=area.Centroid, Plane=PlaneXY(0, 0, 0))  # -> Geometry, Transform

# ---- group: Points
building_boundary = Point([Point(42.59550983, 23.34508128, 0), Point(42.56345959, 8.424039683, 0), Point(16.66961261, 8.263192397, 0), Point(9.562900964, 22.39849545, 0), Point(22.58393511, 38.09001012, 0)])

# ----
building_boundary_2 = Point([Point(15.72822445, 2.268561981, 0), Point(13.96478808, 27.98241881, 0), Point(38.14121451, 31.42391759, 0), Point(58.47185834, 20.1295728, 0), Point(42.69162786, 3.273690727, 0)])
circulation_curve = Point([Point(0.2229832525, 13.89616704, 0), Point(36.14103132, 16.22571897, 0), Point(52.75335036, 36.66669457, 0)])
deconstruct = Deconstruct(Point=building_boundary)  # -> XComponent, YComponent, ZComponent
building_boundary_3 = Point([Point(53.74991237, 22.9996699, 0), Point(49.75309441, 5.148422411, 0), Point(19.05285205, 2.778179251, 0), Point(20.36855582, 25.45106857, 0), Point(41.23395802, 32.23492142, 0)])
points = GetPoint(building_boundary, AtLeast=3, AtMost=5, Realtime=True)

# ---- group: RH_IN:AreaofBlock
area_of_block = Slider(100, range=50..500)

# ---- group: RH_IN:AreaofPlot
area_of_plot = Slider(5, range=0..10)

# ----
display_road_polyline = BooleanToggle(True)

# ---- group: RH_IN:RoadWidth
road_width = Slider(1, range=1..10)

# ----
carve_out_site = BooleanToggle(True)
approximate_area_of_block = Number(area_of_block)
display_your_design = BooleanToggle(True)

# ---- group: RH_IN:MaxFloorHeight
max_floor_height = Slider(5, range=1..10)

# ---- group: RH_IN:SiteRadius
site_radius = Slider(4, range=0..10)

# ---- group: RH_IN:MinFloorHeight
min_floor_height = Slider(2, range=1..10)

# ----
boolean_toggle = BooleanToggle(True)
trees = BooleanToggle(True)

# ---- group: Set your major circulation curve here
circulation_curve_2 = Point([Point(49.62121545, 9.788688635, 0), Point(24.69503343, 21.05360812, 0), Point(4.078669358, 28.47551498, 0)])

# ----
approximate_area_of_plot = Number(area_of_plot)

# ---- group: RH_IN:SitePoint
site_point = Point(Point(30.50805589, 22.3235467, 0))

# ----
move_to_point = MoveToPoint(Geometry=geometry_2, PointA=project.Geometry, PointB=site_point)  # -> Moved, Vector, Transform
polyline = PolyLine(Vertices=circulation_curve_2, Closed=False)
deconstruct_2 = Deconstruct(Point=site_point)  # -> XComponent, YComponent, ZComponent

# ---- group: RH_IN:3d
boolean = Boolean(True)

# ---- group: RH_IN:DisplayTrees
boolean_2 = Boolean(True)

# ---- group: RH_IN:CarveOutSite
boolean_3 = Boolean(True)

# ---- group: RH_IN:DisplayYourDesign
boolean_4 = Boolean(True)

# ---- group: RH_IN:DisplayRoadPolyline
boolean_5 = Boolean(True)

# ----
sitepoint = GetPoint(site_point, AtLeast=1, AtMost=1, Realtime=True)
polyline_2 = PolyLine(Vertices=points, Closed=True)
area_2 = Area(Geometry=polyline_2)  # -> Area, Centroid
sphere = Sphere(Base=sitepoint, Radius=site_radius)
stream_filter = StreamFilter(Gate=boolean_5, Stream1=polyline)
panel = Panel(area_2.Area)

boundary_curves_s = Curve(flatten(polyline_2))
accuracy = Slider(0.381, range=0..1)
surface_to_have_your_unit² = Panel(approximate_area_of_block)

surface_to_have_your_unit²_2 = Panel(approximate_area_of_plot)
explode = Explode(Curve=boundary_curves_s, Recursive=True)  # -> Segments, Vertices
area_of_site = Number(panel)
length = Length(Curve=explode.Segments)
number = Number(accuracy)
division = Division(A=length, B=number)
round = Round(Number=division)  # -> Nearest, Floor, Ceiling
divide_curve = DivideCurve(Curve=explode.Segments, Count=round.Nearest, Kinks=False)  # -> flatten(Points), Tangents, Parameters
voronoi = Voronoi(Points=divide_curve.Points, BruteForceOverride=False)
explode_2 = Explode(Curve=voronoi, Recursive=True)  # -> flatten(Segments), Vertices
curve = Curve(flatten(explode_2.Segments))
boundary_surfaces = BoundarySurfaces(Edges=boundary_curves_s)
division_2 = Division(A=number, B="1")
end_points = EndPoints(Curve=curve)  # -> Start, End
cull_duplicates = CullDuplicates(Points=flatten([end_points.Start, end_points.End]), Tolerance=division_2, CullMode=3)  # -> Points, Indices, Valence
closest_point = ClosestPoint(Point=end_points.Start, Cloud=cull_duplicates.Points)  # -> ClosestPoint, CPIndex, Distance
closest_point_2 = ClosestPoint(Point=end_points.End, Cloud=cull_duplicates.Points)  # -> ClosestPoint, CPIndex, Distance
line = Line(StartPoint=closest_point.ClosestPoint, EndPoint=closest_point_2.ClosestPoint)
division_3 = Division(A=number, B="50")
removeduplicatelines = RemoveDuplicateLines(Lines=line, Tolerance=division_3)
surface_split = SurfaceSplit(Surface=boundary_surfaces, Curves=removeduplicatelines)
surface = Surface(surface_split)
brep_edges = BrepEdges(Brep=surface)  # -> Naked, Interior, NonManifold
curve_2 = Curve(boundary_curves_s)
point_on_curve = PointOnCurve(brep_edges.Naked, parameter=0.5)
list_length = ListLength(List=curve_2)
point = Point(simplify(graft(point_on_curve)))
series = Series(Start=0, Step=1, Count=list_length)
curve_closest_point = CurveClosestPoint(Point=point, Curve=curve_2)  # -> Point, Parameter, simplify(Distance)
sort_list = SortList(Keys=curve_closest_point.Distance, ValuesValuesA=curve_2, ValuesB=series)  # -> Keys, ValuesValuesA, ValuesB
list_item = ListItem(List=sort_list.Keys, Index=0, Wrap=True)
list_item_2 = ListItem(List=sort_list.ValuesValuesA, Index=0, Wrap=True)
list_item_3 = ListItem(List=sort_list.ValuesB, Index=0, Wrap=True)
expression = Expression(x=list_item, Expression="if(x>0.001,0,1)")
dispatch = Dispatch(List=point, DispatchPattern=expression)  # -> ListA, ListB
dispatch_2 = Dispatch(List=list_item_2, DispatchPattern=expression)  # -> ListA, ListB
dispatch_3 = Dispatch(List=list_item_3, DispatchPattern=expression)  # -> ListA, ListB
shift_paths = ShiftPaths(Data=dispatch.ListA, Offset=-1)
shift_paths_2 = ShiftPaths(Data=dispatch_2.ListA, Offset=-1)
shift_paths_3 = ShiftPaths(Data=dispatch_3.ListA, Offset=-1)
surface_2 = Surface(simplify(graft(surface)))
average = Average(Input=shift_paths)
list_item_4 = ListItem(List=shift_paths_2, Index=0, Wrap=True)
list_item_5 = ListItem(List=shift_paths_3, Index=0, Wrap=True)  # -> flatten(Item)
param_viewer = ParamViewer(list_item_4)
param_viewer_2 = ParamViewer(surface_2)
param_viewer_3 = ParamViewer(average)
data_path = DataPath(list_item_5)
replace_paths = ReplacePaths(Data=surface_2, Search=param_viewer_3, Replace=data_path)
replace_paths_2 = ReplacePaths(Data=average, Search=param_viewer_3, Replace=data_path)
replace_paths_3 = ReplacePaths(Data=list_item_4, Search=param_viewer, Replace=data_path)
list_item_6 = ListItem(List=replace_paths_3, Index=0, Wrap=True)
sort_along_curve = SortAlongCurve(Points=replace_paths_2, Curve=list_item_6)  # -> Points, Indices
list_item_7 = ListItem(List=replace_paths, Index=sort_along_curve.Indices, Wrap=True)
area_3 = Area(Geometry=list_item_7)  # -> Area, Centroid
mass_addition = MassAddition(Input=area_3.Area)  # -> Result, PartialResults
division_4 = Division(A=mass_addition.Result, B=surface_to_have_your_unit²)
construct_domain = ConstructDomain(DomainStart="0", DomainEnd=mass_addition.Result)
integer = Integer(division_4)
divide_domain = DivideDomain(Domain=construct_domain, Count=integer)
tree_statistics = TreeStatistics(Tree=divide_domain)  # -> Paths, Length, Count
number_2 = Number(mass_addition.PartialResults)
polyline_3 = PolyLine(Vertices=circulation_curve_2, Closed=False)
number_slider = Slider(2, range=0..10)
duplicate_data = DuplicateData(Data=number_2, Number=graft(tree_statistics.Length), Order=True)
duplicate_data_2 = DuplicateData(Data=list_item_7, Number=graft(tree_statistics.Length), Order=True)
tree_statistics_2 = TreeStatistics(Tree=number_2)  # -> Paths, Length, Count
unit_z = UnitZ(Factor=number_slider)
extrude = Extrude(Base=polyline_2, Direction=unit_z)
unit_z_2 = UnitZ(Factor=expr("-0.5*x", number_slider))
partition_list = PartitionList(List=duplicate_data_2, Size=graft(tree_statistics_2.Length))  # -> simplify(Chunks)
partition_list_2 = PartitionList(List=duplicate_data, Size=graft(tree_statistics_2.Length))  # -> simplify(Chunks)
domain = Domain(simplify(graft(divide_domain)))
offset_curve = OffsetCurve(Curve=polyline_3, Distance=expr("-x", road_width), Plane=PlaneXY(0, 0, 0), Corners=1)
move = Move(Geometry=extrude, Motion=unit_z_2)  # -> Geometry, Transform
offset_curve_2 = OffsetCurve(Curve=polyline_3, Distance=road_width, Plane=PlaneXY(0, 0, 0), Corners=1)
includes = Includes(Value=partition_list_2, Domain=domain)  # -> Includes, Deviation
dispatch_4 = Dispatch(List=partition_list, DispatchPattern=includes.Includes)  # -> ListA, ListB
end_points_2 = EndPoints(Curve=offset_curve)  # -> Start, End
end_points_3 = EndPoints(Curve=offset_curve_2)  # -> Start, End
cap_holes = CapHoles(Brep=move.Geometry)
line_2 = Line(StartPoint=end_points_2.Start, EndPoint=end_points_3.Start)
line_3 = Line(StartPoint=end_points_2.End, EndPoint=end_points_3.End)
brep_join = BrepJoin(Breps=dispatch_4.ListA)  # -> Breps, Closed
merge = Merge(Data1=offset_curve, Data2=line_2, Data3=offset_curve_2, Data4=line_3)
brep_edges_2 = BrepEdges(Brep=brep_join.Breps)  # -> Naked, Interior, NonManifold
join_curves = JoinCurves(Curves=merge, Preserve=False)
split_with_brep = SplitWithBrep(Curve=join_curves, Brep=cap_holes)  # -> Curve, Points
point_on_curve_2 = PointOnCurve(split_with_brep.Curve, parameter=0.5)
mesh_2 = Mesh(brep_join.Breps)
number_slider_2 = Slider(2, range=0..10)
curve_3 = Curve(simplify(brep_edges_2.Naked))
unit_z_3 = UnitZ(Factor=number_slider_2)
mesh_join_2 = MeshJoin(Meshes=mesh_2)  # -> flatten(Mesh)
extrude_2 = Extrude(Base=join_curves, Direction=unit_z_3)
join_curves_2 = JoinCurves(Curves=curve_3, Preserve=False)
unit_z_4 = UnitZ(Factor=expr("-0.5*x", number_slider_2))
point_in_brep = PointInBrep(Brep=cap_holes, Point=point_on_curve_2, Strict=False)
list_length_2 = ListLength(List=mesh_join_2)  # -> expr("x+1", Length)
cap_holes_2 = CapHoles(Brep=extrude_2)
dispatch_5 = Dispatch(List=split_with_brep.Curve, DispatchPattern=point_in_brep)  # -> ListA, ListB
move_2 = Move(Geometry=cap_holes_2, Motion=unit_z_4)  # -> Geometry, Transform
split_with_breps = SplitWithBreps(Curve=join_curves_2, Brep=move_2.Geometry)  # -> simplify(Curve), Points
curve_4 = Curve(simplify(dispatch_5.ListA))
point_on_curve_3 = PointOnCurve(split_with_breps.Curve, parameter=0.5)
point_in_brep_2 = PointInBrep(Brep=move_2.Geometry, Point=point_on_curve_3, Strict=False)
join_curves_3 = JoinCurves(Curves=curve_4, Preserve=False)
dispatch_6 = Dispatch(List=split_with_breps.Curve, DispatchPattern=point_in_brep_2)  # -> ListA, ListB
list_item_8 = ListItem(List=join_curves_3, Index=0, Wrap=True)  # -> Item, Item1
flip_curve = FlipCurve(Curve=list_item_8.Item1)  # -> Curve, Flag
end_points_4 = EndPoints(Curve=list_item_8.Item)  # -> Start, End
curve_5 = Curve(simplify(dispatch_6.ListB))
end_points_5 = EndPoints(Curve=flip_curve.Curve)  # -> Start, End
close_curve = CloseCurve(Curve=curve_5, CloseType=0, Bulge=0.5, Tolerance=0)  # -> Closed, ResultBoolean
line_4 = Line(StartPoint=end_points_4.Start, EndPoint=end_points_5.Start)
line_5 = Line(StartPoint=end_points_4.End, EndPoint=end_points_5.End)
mesh_3 = Mesh(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)
clean_tree = CleanTree(RemoveNulls=True, RemoveInvalid=True, RemoveEmpty=True, Tree=close_curve.Closed)
volume = Volume(Geometry=mesh_3)  # -> Volume, Centroid
merge_2 = Merge(Data1=join_curves_3, Data2=line_4, Data3=line_5)
project_2 = Project(Geometry=volume.Centroid, Plane=PlaneXY(0, 0, 0))  # -> Geometry, Transform
boundary_surfaces_2 = BoundarySurfaces(Edges=clean_tree)  # -> flatten(Surfaces)
area_4 = Area(Geometry=boundary_surfaces_2)  # -> Area, Centroid
smaller_than = SmallerThan(FirstNumber=area_4.Area, SecondNumber=expr("x/10", surface_to_have_your_unit²))  # -> SmallerThan, OrEqualTo
dispatch_7 = Dispatch(List=boundary_surfaces_2, DispatchPattern=smaller_than.SmallerThan)  # -> ListA, ListB
join_curves_4 = JoinCurves(Curves=merge_2, Preserve=False)
bounding_rectangle = BoundingRectangle(Geometry=dispatch_7.ListB, Plane=PlaneXY(0, 0, 0), Axis=0, Slide=0, Union=True)  # -> Bounding, DimensionX, DimensionY
point_2 = Point(project_2.Geometry)
weld = WeldMesh(Mesh=mesh_3, Angle=3.141592654)
boundary_surfaces_3 = BoundarySurfaces(Edges=join_curves_4)
area_5 = Area(Geometry=bounding_rectangle.Bounding)  # -> Area, Centroid
demesh = DeconstructMesh(Mesh=weld)  # -> Vertices, Faces, Colours, Normals
curve_6 = Curve(dispatch_7.ListB)
deconstruct_3 = Deconstruct(Point=demesh.Vertices)  # -> XComponent, YComponent, ZComponent
area_6 = Area(Geometry=dispatch_7.ListB)  # -> Area, Centroid
area_7 = Area(Geometry=curve_6)  # -> Area, Centroid
bounds = Bounds(Numbers=deconstruct_3.ZComponent)
divide_curve_2 = DivideCurve(Curve=join_curves_3, Count=10, Kinks=False)  # -> Points, Tangents, Parameters
colour_wheel = ColourWheel(
    list_length_2,
    ColourGrips_Style=31,
    ColourGrips_Grip=[1.569339482, 3.663734584, 5.758129687, 3.141592654],
    ColourGrips_Lum=[0.08264677723, 0.683393732],
    ColourGrips_Range=[0.2617993878, 0.2617993878, 0.2617993878, 0.2617993878],
    ColourGrips_Sat=[0.2, 0.9315876961])
remap_numbers = RemapNumbers(Value=deconstruct_3.ZComponent, Source=bounds, Target=Domain(0, 1))  # -> Mapped, Clipped
unit_z_5 = UnitZ(Factor=1)
polygon = Polygon(Plane=divide_curve_2.Points, Radius=0.1, Segments=4, FilletRadius=0)  # -> Polygon, Length
move_away_from = MoveAwayFrom(Geometry=dispatch_7.ListB, Emitter=area_5.Centroid, Distance=Slider(17, range=0..100))  # -> Geometry, Transform
area_8 = Area(Geometry=move_away_from.Geometry)  # -> Area, Centroid
scale = Scale(Geometry=curve_6, Center=area_7.Centroid, Factor=Slider(0.84, range=0..1))  # -> Geometry, Transform
gradient = Gradient(
    LowerLimit=0,
    UpperLimit=1,
    Parameter=remap_numbers.Mapped,
    stops=[0: RGB(71, 61, 34), 0.625: RGB(171, 151, 22), 0.836: RGB(59, 102, 9)])
line_sdl = LineSDL(Start=divide_curve_2.Points, Direction=unit_z_5, Length=Slider(1, range=0..10))
end_points_6 = EndPoints(Curve=line_sdl)  # -> Start, End
point_3 = Point(end_points_6.End)
extrude_3 = Extrude(Base=polygon.Polygon, Direction=unit_z_5)
cluster = Cluster(data=gradient)
stream_filter_2 = StreamFilter(Gate=0, Stream0=gradient, Stream1=cluster)
mesh_sphere = MeshSphere(Base=point_3, Radius=Slider(0.5, range=0..1), UCount=5, VCount=5)  # -> simplify(Mesh)
expression_2 = Expression(x=area_8.Area, Expression="Format(\"{0:0.00}\", x)")  # disabled
number_slider_3 = Slider(1, range=0..10)  # disabled

boundary_curves_s_2 = Curve(flatten(scale.Geometry))
accuracy_2 = Slider(0.381, range=0..1)
surface_to_have_your_unit²_3 = Panel(surface_to_have_your_unit²_2)

cap_holes_3 = CapHoles(Brep=extrude_3)
panel_2 = Panel("black")  # disabled
explode_3 = Explode(Curve=boundary_curves_s_2, Recursive=True)  # -> Segments, Vertices
mcol = MeshColours(Mesh=weld, Colours=stream_filter_2)
boolean_6 = Boolean(invert(boolean))
line_6 = Line(StartPoint=area_8.Centroid, EndPoint=area_6.Centroid)
mblur = BlurMesh(Mesh=mcol, Iterations=Slider(1, range=0..5))
length_2 = Length(Curve=explode_3.Segments)
mesh_brep = MeshBrep(
    Brep=cap_holes_3,
    Settings={GridMaxCount=0, GridMinCount=16, JaggedSeams=False, MaxEdgeLength=0, MinEdgeLength=0.0001, MinTolerance=0, Refine=True, RefineAngle=0, RelativeTolerance=0.65, SimplePlanes=True, Tolerance=0})
stream_filter_3 = StreamFilter(Gate=boolean_6, Stream1=line_6)
stream_filter_4 = StreamFilter(Gate=boolean_6, Stream1=move_away_from.Geometry)
number_3 = Number(accuracy_2)
mesh_join_3 = MeshJoin(Meshes=flatten([mesh_brep, mesh_sphere]))
move_to_point_2 = MoveToPoint(Geometry=mblur, PointA=point_2, PointB=divide_curve_2.Points)  # -> Moved, Vector, Transform
division_5 = Division(A=length_2, B=number_3)
text_tag_3d = TextTag3D(Location=area_8.Centroid, Text=expression_2, Size=number_slider_3, Colour=panel_2, Justification=5)  # disabled
custom_preview = CustomPreview(Geometry=stream_filter_4, Material=colour_wheel)
round_2 = Round(Number=division_5)  # -> Nearest, Floor, Ceiling
curve_7 = Curve(stream_filter_3)
divide_curve_3 = DivideCurve(Curve=explode_3.Segments, Count=round_2.Nearest, Kinks=False)  # -> flatten(Points), Tangents, Parameters
voronoi_2 = Voronoi(Points=divide_curve_3.Points, BruteForceOverride=False)
explode_4 = Explode(Curve=voronoi_2, Recursive=True)  # -> flatten(Segments), Vertices
unit_z_6 = UnitZ(Factor=0.1)
curve_8 = Curve(flatten(explode_4.Segments))
boundary_surfaces_4 = BoundarySurfaces(Edges=boundary_curves_s_2)
division_6 = Division(A=number_3, B="1")
end_points_7 = EndPoints(Curve=curve_8)  # -> Start, End
cull_duplicates_2 = CullDuplicates(Points=flatten([end_points_7.Start, end_points_7.End]), Tolerance=division_6, CullMode=3)  # -> Points, Indices, Valence
context_curve = Curve(polyline_2)
closest_point_3 = ClosestPoint(Point=end_points_7.Start, Cloud=cull_duplicates_2.Points)  # -> ClosestPoint, CPIndex, Distance
closest_point_4 = ClosestPoint(Point=end_points_7.End, Cloud=cull_duplicates_2.Points)  # -> ClosestPoint, CPIndex, Distance
boundary_surfaces_5 = BoundarySurfaces(Edges=context_curve)
unit_z_7 = UnitZ(Factor=expr("-x", 1))
unit_z_8 = UnitZ(Factor=0.1)
line_7 = Line(StartPoint=closest_point_3.ClosestPoint, EndPoint=closest_point_4.ClosestPoint)
extrude_4 = Extrude(Base=boundary_surfaces_3, Direction=unit_z_8)
division_7 = Division(A=number_3, B="50")
extrude_5 = Extrude(Base=boundary_surfaces_5, Direction=unit_z_7)
mesh_brep_2 = MeshBrep(
    Brep=extrude_4,
    Settings={GridMaxCount=0, GridMinCount=16, JaggedSeams=False, MaxEdgeLength=0, MinEdgeLength=0.0001, MinTolerance=0, Refine=True, RefineAngle=0, RelativeTolerance=0.65, SimplePlanes=True, Tolerance=0})
mesh_brep_3 = MeshBrep(
    Brep=extrude_5,
    Settings={GridMaxCount=0, GridMinCount=16, JaggedSeams=False, MaxEdgeLength=0, MinEdgeLength=0.0001, MinTolerance=0, Refine=True, RefineAngle=0, RelativeTolerance=0.65, SimplePlanes=True, Tolerance=0})
removeduplicatelines_2 = RemoveDuplicateLines(Lines=line_7, Tolerance=division_7)
stream_filter_5 = StreamFilter(Gate=boolean_2, Stream1=move_to_point_2.Moved)
stream_filter_6 = StreamFilter(Gate=boolean_4, Stream1=move_to_point.Moved)
surface_split_2 = SurfaceSplit(Surface=boundary_surfaces_4, Curves=removeduplicatelines_2)
mesh_join_4 = MeshJoin(Meshes=flatten(stream_filter_5))
mcol_2 = MeshColours(Mesh=mesh_brep_2, Colours=graft(ColourSwatch(SwatchColor=RGB(145, 145, 145))))  # -> flatten(Mesh)
mcol_3 = MeshColours(Mesh=mesh_brep_3, Colours=graft(ColourSwatch(SwatchColor=RGB(255, 255, 255))))  # -> flatten(Mesh)
mcol_4 = MeshColours(Mesh=stream_filter_6, Colours=graft(ColourSwatch(SwatchColor=RGB(255, 255, 255))))  # -> flatten(Mesh)
surface_3 = Surface(surface_split_2)
brep_edges_3 = BrepEdges(Brep=surface_3)  # -> Naked, Interior, NonManifold
curve_9 = Curve(boundary_curves_s_2)
mjoin = MeshJoin(Meshes=mcol_2)
mjoin_2 = MeshJoin(Meshes=mcol_3)
mjoin_3 = MeshJoin(Meshes=mcol_4)
point_on_curve_4 = PointOnCurve(brep_edges_3.Naked, parameter=0.5)
list_length_3 = ListLength(List=curve_9)

# ---- group: RH_OUT:RoadPolylineCurve
road_polyline_curve = Curve(stream_filter)

# ---- group: RH_OUT:BlockCurves
block_curves = Curve(flatten(dispatch_7.ListB))

# ---- group: RH_OUT:DesignMesh
design_mesh = Mesh(mjoin_3)

# ---- group: RH_OUT:ContextMesh
context_mesh = Mesh(mjoin_2)

# ---- group: RH_OUT:RoadMesh
road_mesh = Mesh(mjoin)

# ---- group: RH_OUT:TreesMesh
trees_mesh = Mesh(mesh_join_4)

# ----
point_4 = Point(simplify(graft(point_on_curve_4)))
series_2 = Series(Start=0, Step=1, Count=list_length_3)
mesh_edges = MeshEdges(Mesh=design_mesh)  # -> NakedEdges, InteriorEdges, NonManifoldEdges
curve_closest_point_2 = CurveClosestPoint(Point=point_4, Curve=curve_9)  # -> Point, Parameter, simplify(Distance)
sort_list_2 = SortList(Keys=curve_closest_point_2.Distance, ValuesValuesA=curve_9, ValuesB=series_2)  # -> Keys, ValuesValuesA, ValuesB
list_item_9 = ListItem(List=sort_list_2.Keys, Index=0, Wrap=True)
list_item_10 = ListItem(List=sort_list_2.ValuesValuesA, Index=0, Wrap=True)

# ---- group: RH_OUT:DesignCurves
curve_10 = Curve(mesh_edges.NakedEdges)

# ----
list_item_11 = ListItem(List=sort_list_2.ValuesB, Index=0, Wrap=True)
expression_3 = Expression(x=list_item_9, Expression="if(x>0.001,0,1)")
dispatch_8 = Dispatch(List=point_4, DispatchPattern=expression_3)  # -> ListA, ListB
dispatch_9 = Dispatch(List=list_item_10, DispatchPattern=expression_3)  # -> ListA, ListB
dispatch_10 = Dispatch(List=list_item_11, DispatchPattern=expression_3)  # -> ListA, ListB
shift_paths_4 = ShiftPaths(Data=dispatch_8.ListA, Offset=-1)
shift_paths_5 = ShiftPaths(Data=dispatch_9.ListA, Offset=-1)
shift_paths_6 = ShiftPaths(Data=dispatch_10.ListA, Offset=-1)
surface_4 = Surface(simplify(graft(surface_3)))
average_2 = Average(Input=shift_paths_4)
list_item_12 = ListItem(List=shift_paths_5, Index=0, Wrap=True)
list_item_13 = ListItem(List=shift_paths_6, Index=0, Wrap=True)  # -> flatten(Item)
param_viewer_4 = ParamViewer(list_item_12)
param_viewer_5 = ParamViewer(surface_4)
param_viewer_6 = ParamViewer(average_2)
data_path_2 = DataPath(list_item_13)
replace_paths_4 = ReplacePaths(Data=surface_4, Search=param_viewer_6, Replace=data_path_2)
replace_paths_5 = ReplacePaths(Data=average_2, Search=param_viewer_6, Replace=data_path_2)
replace_paths_6 = ReplacePaths(Data=list_item_12, Search=param_viewer_4, Replace=data_path_2)
list_item_14 = ListItem(List=replace_paths_6, Index=0, Wrap=True)
sort_along_curve_2 = SortAlongCurve(Points=replace_paths_5, Curve=list_item_14)  # -> Points, Indices
list_item_15 = ListItem(List=replace_paths_4, Index=sort_along_curve_2.Indices, Wrap=True)
area_9 = Area(Geometry=list_item_15)  # -> Area, Centroid
mass_addition_2 = MassAddition(Input=area_9.Area)  # -> Result, PartialResults
division_8 = Division(A=mass_addition_2.Result, B=surface_to_have_your_unit²_3)
construct_domain_2 = ConstructDomain(DomainStart="0", DomainEnd=mass_addition_2.Result)
integer_2 = Integer(division_8)
divide_domain_2 = DivideDomain(Domain=construct_domain_2, Count=integer_2)
tree_statistics_3 = TreeStatistics(Tree=divide_domain_2)  # -> Paths, Length, Count
number_4 = Number(mass_addition_2.PartialResults)
duplicate_data_3 = DuplicateData(Data=number_4, Number=graft(tree_statistics_3.Length), Order=True)
duplicate_data_4 = DuplicateData(Data=list_item_15, Number=graft(tree_statistics_3.Length), Order=True)
tree_statistics_4 = TreeStatistics(Tree=number_4)  # -> Paths, Length, Count
partition_list_3 = PartitionList(List=duplicate_data_4, Size=graft(tree_statistics_4.Length))  # -> simplify(Chunks)
partition_list_4 = PartitionList(List=duplicate_data_3, Size=graft(tree_statistics_4.Length))  # -> simplify(Chunks)
domain_2 = Domain(simplify(graft(divide_domain_2)))
includes_2 = Includes(Value=partition_list_4, Domain=domain_2)  # -> Includes, Deviation
dispatch_11 = Dispatch(List=partition_list_3, DispatchPattern=includes_2.Includes)  # -> ListA, ListB
brep_join_2 = BrepJoin(Breps=dispatch_11.ListA)  # -> Breps, Closed
brep_edges_4 = BrepEdges(Brep=brep_join_2.Breps)  # -> Naked, Interior, NonManifold
curve_11 = Curve(simplify(brep_edges_4.Naked))
join_curves_5 = JoinCurves(Curves=curve_11, Preserve=False)  # -> simplify(Curves)
area_10 = Area(Geometry=join_curves_5)  # -> Area, Centroid
point_in_brep_3 = PointInBrep(Brep=sphere, Point=area_10.Centroid, Strict=False)
dispatch_12 = Dispatch(List=join_curves_5, DispatchPattern=point_in_brep_3)  # -> ListA, ListB
curve_12 = Curve(dispatch_12.ListA)
region_union = RegionUnion(Curves=flatten(curve_12))
site_surface = Surface(region_union)
extrude_6 = Extrude(Base=site_surface, Direction=unit_z_6)
mesh_brep_4 = MeshBrep(
    Brep=extrude_6,
    Settings={GridMaxCount=0, GridMinCount=16, JaggedSeams=False, MaxEdgeLength=0, MinEdgeLength=0.0001, MinTolerance=0, Refine=True, RefineAngle=0, RelativeTolerance=0.65, SimplePlanes=True, Tolerance=0})  # -> flatten(Mesh)
mesh_join_5 = MeshJoin(Meshes=mesh_brep_4)
stream_filter_7 = StreamFilter(Gate=boolean_3, Stream1=mesh_join_5)
mcol_5 = MeshColours(Mesh=stream_filter_7, Colours=graft(ColourSwatch(SwatchColor=RGB(255, 0, 0))))  # -> flatten(Mesh)
mjoin_4 = MeshJoin(Meshes=mcol_5)

# ---- group: RH_OUT:SiteMesh
site_mesh = Mesh(mjoin_4)

# ----
curve_13 = Curve(dispatch_12.ListB)
stream_filter_8 = StreamFilter(Gate=boolean_3, Stream0=join_curves_5, Stream1=curve_13)

# ---- group: RH_OUT:PlotCurves
plot_curves = Curve(flatten(stream_filter_8))

# ----
area_11 = Area(Geometry=stream_filter_8)  # -> Area, Centroid
construct_domain_3 = ConstructDomain(DomainStart=min_floor_height, DomainEnd=max_floor_height)
scale_2 = Scale(Geometry=stream_filter_8, Center=area_11.Centroid, Factor=Slider(0.7, range=0..1))  # -> Geometry, Transform
list_length_4 = ListLength(List=flatten(scale_2.Geometry))
random = Random(Range=construct_domain_3, Number=list_length_4, Seed=2)
unit_z_9 = UnitZ(Factor=random)
extrude_7 = Extrude(Base=scale_2.Geometry, Direction=graft(unit_z_9))  # -> simplify(Extrusion)
cap_holes_4 = CapHoles(Brep=extrude_7)
stream_filter_9 = StreamFilter(Gate=boolean_6, Stream0=cap_holes_4)
mesh_brep_5 = MeshBrep(
    Brep=flatten(stream_filter_9),
    Settings={GridMaxCount=0, GridMinCount=1, JaggedSeams=False, MaxEdgeLength=0, MinEdgeLength=0.0001, MinTolerance=0, Refine=True, RefineAngle=0, RelativeTolerance=0.65, SimplePlanes=True, Tolerance=0})
list_indices = ListIndices(List=mesh_brep_5)
list_length_5 = ListLength(List=mesh_brep_5)
gradient_2 = Gradient(
    LowerLimit=0,
    UpperLimit=list_length_5,
    Parameter=list_indices,
    stops=[0: RGB(234, 38, 0), 0.25: RGB(234, 126, 0), 0.5: RGB(254, 244, 84), 0.75: RGB(173, 203, 249), 1: RGB(75, 107, 169)])
mesh_colours = MeshColours(Mesh=graft(mesh_brep_5), Colours=graft(gradient_2))
mesh_join_6 = MeshJoin(Meshes=flatten(mesh_colours))

# ---- group: RH_OUT:BuildingsMesh
buildings_mesh = Mesh(mesh_join_6)

# ==== cluster Cluster
data = ClusterInput()
data_2 = Data(data)
text_split = TextSplit(Text=data_2, Separators=",")
B = ClusterInput()
list_item = ListItem(List=text_split, Index=0, Wrap=True)  # -> Item, Item1, Item2
multiplication = Multiplication(A=list_item.Item1, B=B)
merge = Merge(Data1=list_item.Item, Data2=multiplication, Data3=list_item.Item2)
text_join = TextJoin(Text=merge, Join=",")  # -> flatten(Result)
jitter = Jitter(List=text_join, Jitter=Slider(0.06, range=0..1), Seed=2)  # -> Values, Indices
data_3 = Data(jitter.Values)
data_4 = ClusterOutput(data_3)
